# Grasshopper definition hoberman.gh (Grasshopper 1.0.7)

pipe_radius = Slider(0.218, range=0..1)
edge_count = Slider(19, range=9..30)
shrinkratio = Slider(1, range=0..1)
circle_radius = Slider(9, range=0..100)
division = Division(A360=360, BEdge=edge_count)
rad = Radians(ThetaInDegree=division)
multiplication = Multiplication(ARadius=circle_radius, BShrinkRate=shrinkratio)
division_2 = Division(ARadTheta=rad, B2=2)
cos = Cosine(Value=rad)
sin = Sine(Value=rad)
division_3 = Division(ATheta2=division_2, B2=2)
rad_2 = Radians(Degrees=45)
cos_2 = Cosine(Value=division_2)
sin_2 = Sine(Value=division_2)
a_b = Subtraction(ARadius=circle_radius, BClosedness=multiplication)
multiplication_2 = Multiplication(ASinTheta2=sin_2, BRadius=circle_radius)
a_b_2 = Subtraction(ARad45=rad_2, BTheta4=division_3)
multiplication_3 = Multiplication(ASinTheta2=sin_2, BCurrentRadius=a_b)
tan = Tangent(Value=a_b_2)
division_4 = Division(ABy=multiplication_3, BDistance_AB=multiplication_2)
multiplication_4 = Multiplication(ACosTheta2=cos_2, BCurrentRadius=a_b)
multiplication_5 = Multiplication(BTanAlpha=tan)
acos = ArcCosine(Value=division_4)
sin_3 = Sine(Value=acos)
addition = Addition(AEpsilon=acos, BAlpha=a_b_2)
multiplication_6 = Multiplication(ASinEpsilon=sin_3, BDistance_AB=multiplication_2)
sin_4 = Sine(Value=addition)
addition_2 = Addition(ABx=multiplication_4, BDistance_ABSinEpsilon=multiplication_6)
multiplication_7 = Multiplication(ASinAlphaEpsilon=sin_4, BDistance_CB=multiplication_5)
multiplication_8 = Multiplication(ACosTheta=cos, BDistance_OA=addition_2)
multiplication_9 = Multiplication(ASinTheta=sin, BDistance_OA=addition_2)
subtraction = Subtraction(ABx=multiplication_4, BDistance_CBSinAlphaEpsilon=multiplication_7)
multiplication_10 = Multiplication(AEdgeCount=edge_count, B2=2)
python = GhPythonScript(
    Ax=multiplication_8,
    Ay=multiplication_9,
    Bx=multiplication_4,
    By=multiplication_3,
    Cx=subtraction,
    Cy=0,
    edgeCount=edge_count,
    pipeRadius=pipe_radius)  # -> ArcList
# ---------- python: Python ----------
__author__ = "Berk Aktug"
__version__ = "2019.12.06"

import rhinoscriptsyntax as rs
import Rhino
import scriptcontext
import System.Guid

import math # for  cos, sin, acos, tan

def RotateAround(Point, pivot, angle):
	# Calculating sine and cosines:
	angleSin = math.sin(angle)
	angleCos = math.cos(angle)

	# Translating pivot to 0,0:
	Point.X = Point.X - pivot.X
	Point.Y = Point.Y - pivot.Y

	# Rotating the Point 
	newX = Point.X * angleCos - Point.Y * angleSin
	newY = Point.X * angleSin + Point.Y * angleCos

	# Translate Point back to its pivot
	Point.X = newX + pivot.X
	Point.Y = newY + pivot.Y


def FormHobermanCircle(Ax, Ay, Bx, By, Cx, Cy, edgeCount):
    Origin = rs.CreatePoint(0.0, 0.0, 0.0)
    edgeCount = int(edgeCount)
    
    # Calculate single angle in polygon with count = edgeCount:
    theta = (360 / edgeCount)

    # Define Initial Angle:
    current_angle = 0

    # Define The List That Will Store Hoberman Groups Formed By 3 Points:
    hobermanArcList = []

    # Define Sign Which Will Be Used to Create Other Chain of Hoberman Circle:
    sign = 1

    for j in range(2):
        for i in range(edgeCount):
            # Calculate Current Angle in Radians:
            current_radian = math.radians(current_angle)
    
            # Define Points A, B and C:
            pointB = rs.CreatePoint(Bx + Origin.X, sign * By + Origin.Y)
            pointA = rs.CreatePoint(Ax + Origin.X, sign * Ay + Origin.Y)
            pointC = rs.CreatePoint(Cx + Origin.X, sign * Cy + Origin.Y)
    
            # Rotate the points:
            RotateAround(pointB, Origin, current_radian)
            RotateAround(pointA, Origin, current_radian)
            RotateAround(pointC, Origin, current_radian)
            
            # Store hoberman arc (point A, point B and point C):
            hobermanArc = rs.AddPolyline([pointA, pointB, pointC])
            hobermanArcList.append(hobermanArc)

            # Increment Rotation Angle:
            current_angle = theta + current_angle
        
        # Flip the Sign and Refresh Starting Angle:
        sign = -1 * sign
        current_angle = 0
    
    return hobermanArcList

ArcList = FormHobermanCircle(Ax, Ay, Bx, By, Cx, Cy, edgeCount)
# ---------- end python ----------
series = Series(Start=0, Step=1, Count=multiplication_10)
item = ListItem(List=python, Index=series, Wrap=True)
pipe = Pipe(Curve=item, Radius=pipe_radius, Caps=0)
