# Grasshopper definition hoberman_unfinished.gh (Grasshopper 1.0.7)

shrinkratio = Slider(25.339, range=0..100)
radius = Slider(354, range=0..1000)
edge_count = Slider(27, range=9..30)
closedness = GhPythonScript(radius=radius, shrinkRatio=shrinkratio)  # -> closedness
# ---------- closedness: Python ----------
__author__ = "Cyborn"
__version__ = "2019.12.04"

import rhinoscriptsyntax as rs

closedness = (radius * (shrinkRatio/100))
# ---------- end closedness ----------
theta_radian = GhPythonScript(edgeCount=edge_count)  # -> theta; inputs edgeCount: Int32
# ---------- theta_radian: Python ----------
__author__ = "Cyborn"
__version__ = "2019.12.04"

import rhinoscriptsyntax as rs
import math

toRadians = math.pi / 180

theta = (360 / edgeCount) * toRadians
# ---------- end theta_radian ----------
python = GhPythonScript(thetaRadian=theta_radian, radius=radius, closedness=closedness)  # -> PointB, PointA, PointC
# ---------- python: Python ----------
__author__ = "Cyborn"
__version__ = "2019.12.04"

import rhinoscriptsyntax as rs
import math # for  cos, sin, acos, tan

Origin = rs.CreatePoint(0.0, 0.0, 0.0)

# Calculate Distance Between Point A and B:
distanceAB = radius * math.sin(thetaRadian/2)

# Calculate Angles Alpha and Epsilon:
#		# Epsilon is the Angle between A and line perpendicular to hypotenuse drawn from point B.
#		# Alpha is the one third of the angle ABC^.
alpha = 45 * (math.pi / 180) - (thetaRadian / 4)

# Calculate Distance Between Points C and B:
distanceCB = math.tan(alpha) * distanceAB

# Define Closedness:
# closedness = (closednessUnit * (radius - distanceCB))
#closedness = (radius * (closednessUnit/100))

# Calculate Point B:
Bx = (radius - closedness) * math.cos(thetaRadian/2)
By = (radius - closedness) * math.sin(thetaRadian/2)
PointB = rs.AddPoint(Bx, By)

epsilon = math.acos(By / distanceAB)

# Calculate Distance of A From The Origin:
distanceOA = Bx + (distanceAB * math.sin(epsilon))

# Calculate Point A:
Ax = distanceOA * math.cos(thetaRadian)
Ay = distanceOA * math.sin(thetaRadian)
PointA = rs.AddPoint(Ax, Ay)

# Calculate Point C:
Cx = Bx - (distanceCB * math.sin(alpha + epsilon))
Cy = 0
PointC = rs.AddPoint(Cx,Cy)
# ---------- end python ----------
